# Grasshopper definition Geometry1.gh (Grasshopper 1.0.7)
# plug-ins: Pufferfish, Kangaroo Components, Wombat

polygon = Polygon(Plane=PlaneXY(0, 0, 0), Radius=Slider(1.34, range=0..10), Segments=Slider(10, range=0..10), FilletRadius=0)  # -> Polygon, Length
explode = Explode(Curve=polygon.Polygon, Recursive=True)  # -> Segments, Vertices
lastdex = LastIndex(List=explode.Vertices)
Z = UnitZ(Factor=1)
cull_i = CullIndex(List=explode.Vertices, Indices=lastdex, Wrap=True)
number_slider = Slider(10.6, range=0..90)
pl = ConstructPlane(Origin=cull_i, XAxis=explode.Segments, YAxis=Z)
shift = ShiftList(List=cull_i, Shift=1, Wrap=True)
rotate = Rotate(Geometry=shift, Angle=degrees(number_slider), Plane=pl)  # -> Geometry, Transform
ln = Line(StartPoint=cull_i, EndPoint=rotate.Geometry)
end = EndPoints(Curve=ln)  # -> Start, End
panel = Panel("""0
1
2""")
shift_2 = ShiftList(List=end.Start, Shift=1, Wrap=True)
shift_3 = ShiftList(List=end.End, Shift=1, Wrap=True)
weave = Weave(Pattern=panel, Stream0=graft(end.Start), Stream1=graft(shift_2), Stream2=graft(shift_3), NullGaps=False)
weave_2 = Weave(Pattern=panel, Stream0=graft(end.Start), Stream1=graft(end.End), Stream2=graft(shift_3), NullGaps=False)
shift_4 = ShiftList(List=end.End, Shift="-1", Wrap=True)
pline = PolyLine(Vertices=weave, Closed=True)
pline_2 = PolyLine(Vertices=weave_2, Closed=True)
boundarym = BoundaryMesh(Polyline=pline)
boundarym_2 = BoundaryMesh(Polyline=pline_2)
pline_3 = PolyLine(Vertices=shift_4, Closed=True)

# ---- group: RH_IN:Angle
num = Number(Slider(90, range=10..90))

# ----
cluster = Cluster(C=pline_3, A=number_slider)  # -> pl_2, M, M_2
dom = ConstructDomain(DomainStart="0", DomainEnd="90")
dom_2 = ConstructDomain(DomainStart="1", DomainEnd="-1.84")
cluster_2 = Cluster(C=cluster.pl_2, A=number_slider)  # -> pl_2, M, M_2
abs = Absolute(Value=num)
cluster_3 = Cluster(C=cluster_2.pl_2, A=number_slider)  # -> pl_2, M, M_2
remap = RemapNumbers(Value=abs, Source=dom, Target=dom_2)  # -> Mapped, Clipped
cluster_4 = Cluster(C=cluster_3.pl_2, A=number_slider)  # -> pl_2, M, M_2
cluster_5 = Cluster(C=cluster_4.pl_2, A=number_slider)  # -> pl_2, M, M_2
cluster_6 = Cluster(C=cluster_5.pl_2, A=number_slider)  # -> pl_2, M, M_2
merge = Merge(Data1=flatten([boundarym_2, boundarym, cluster.M, cluster.M_2, cluster_2.M, cluster_2.M_2, cluster_3.M, cluster_3.M_2, cluster_4.M, cluster_4.M_2, cluster_5.M, cluster_5.M_2, cluster_6.M, cluster_6.M_2]))
nv = NakedVertices(Mesh=merge)  # -> ClothedIndex, NakedIndex, ClothedPts, NakedPts
pdecon = Deconstruct(Point=nv.NakedPts)  # -> XComponent, YComponent, ZComponent
pt = ConstructPoint(XCoordinate=pdecon.XComponent, YCoordinate=pdecon.YComponent, ZCoordinate=0)
vec2pt = Vector2Pt(PointA=nv.NakedPts, PointB=pt, Unitize=False)  # -> Vector, Length
multiplication = Multiplication(A=vec2pt.Vector, B=remap.Mapped)
move = Move(Geometry=nv.NakedPts, Motion=multiplication)  # -> Geometry, Transform
pline_4 = PolyLine(Vertices=move.Geometry, Closed=True)  # -> flatten(Polyline)
boundarym_3 = BoundaryMesh(Polyline=pline_4)
mjoin = MeshJoin(Meshes=flatten(boundarym_3))
clean = CombineClean(Meshes=mjoin)
offmsh = OffsetMesh(Mesh=clean, Distance=Slider(0.005, range=0..0.01), BothSides=True, CreateSolid=True)
unweld = UnweldMesh(Mesh=offmsh, Angle=1.570796327)

# ---- group: RH_OUT:Panels
geo = Geometry(unweld)

# ==== cluster Cluster
C = ClusterInput()
explode = Explode(Curve=C, Recursive=True)  # -> Segments, Vertices
lastdex = LastIndex(List=explode.Vertices)
Z = UnitZ(Factor=1)
cull_i = CullIndex(List=explode.Vertices, Indices=lastdex, Wrap=True)
pl = ConstructPlane(Origin=cull_i, XAxis=explode.Segments, YAxis=Z)
shift = ShiftList(List=cull_i, Shift=1, Wrap=True)
A = ClusterInput()
rotate = Rotate(Geometry=shift, Angle=degrees(A), Plane=pl)  # -> Geometry, Transform
ln = Line(StartPoint=cull_i, EndPoint=rotate.Geometry)
end = EndPoints(Curve=ln)  # -> Start, End
panel = Panel("""0
1
2""")
shift_2 = ShiftList(List=end.Start, Shift=1, Wrap=True)
shift_3 = ShiftList(List=end.End, Shift=1, Wrap=True)
weave = Weave(Pattern=panel, Stream0=graft(end.Start), Stream1=graft(shift_2), Stream2=graft(shift_3), NullGaps=False)
weave_2 = Weave(Pattern=panel, Stream0=graft(end.Start), Stream1=graft(end.End), Stream2=graft(shift_3), NullGaps=False)
shift_4 = ShiftList(List=end.End, Shift="-1", Wrap=True)
pline = PolyLine(Vertices=weave, Closed=True)
pline_2 = PolyLine(Vertices=weave_2, Closed=True)
boundarym = BoundaryMesh(Polyline=pline)
boundarym_2 = BoundaryMesh(Polyline=pline_2)
pline_3 = PolyLine(Vertices=shift_4, Closed=True)
pl_2 = ClusterOutput(pline_3)
M = ClusterOutput(boundarym_2)
M_2 = ClusterOutput(boundarym)
