# Grasshopper definition Geometry2.gh (Grasshopper 1.0.7)
# plug-ins: Kangaroo Components

number_slider = Slider(10, range=0..100)
addition = Addition(A=number_slider, B="1")
multiplication = Multiplication(A=addition, B="2")
multiplication_2 = Multiplication(A=number_slider, B="2")
polygon = Polygon(Plane=PlaneXY(0, 0, 0), Radius=Slider(1.26, range=0..10), Segments=multiplication_2, FilletRadius=0)  # -> Polygon, Length
explode = Explode(Curve=polygon.Polygon, Recursive=True)  # -> Segments, Vertices
item = ListItem(List=explode.Segments, Index=0, Wrap=True)

# ---- group: RH_IN:Angle
num = Number(Slider(90, range=0..90))

# ----
len = Length(Curve=item)
curvepoint = PointOnCurve(item, parameter=0.5)
pt = ConstructPoint(XCoordinate=0, YCoordinate=0, ZCoordinate=0)
multiplication_3 = Multiplication(A=len, B=Slider(0.9, range=0..1))
division = Division(A=multiplication_3, B="2")
vec2pt = Vector2Pt(PointA=curvepoint, PointB=pt, Unitize=False)  # -> Vector, Length
division_2 = Division(A="360", B=multiplication)
neg = Negative(Value="0.005")
neg_2 = Negative(Value=division)
pl = ConstructPlane(Origin=curvepoint, XAxis=vec2pt.Vector, YAxis=Vector(0, 1, 0))
series = Series(Start=0, Step=division_2, Count=multiplication)
dom = ConstructDomain(DomainStart=division, DomainEnd=neg_2)
dom_2 = ConstructDomain(DomainStart=neg, DomainEnd="0.005")
rectangle = Rectangle(Plane=pl, XSize=dom_2, YSize=dom, Radius=0)  # -> Rectangle, Length
rotate = Rotate(Geometry=rectangle.Rectangle, Angle=degrees(num), Plane=curvepoint)  # -> Geometry, Transform
rotate_2 = Rotate(Geometry=rotate.Geometry, Angle=degrees(series), Plane=PlaneXY(0, 0, 0))  # -> Geometry, Transform
Z = UnitZ(Factor=Slider(3, range=0..10))
move = Move(Geometry=flatten(rotate_2.Geometry), Motion=Z)  # -> Geometry, Transform
weld = Slider(0, range=0..1)
weave = Weave(Pattern=[0, 1], Stream0=graft(rotate_2.Geometry), Stream1=graft(move.Geometry), NullGaps=False)
loft_mesh = CSharpScript(Polylines=weave, Weld=weld, TooltipTextOverride="Create a lofted mesh through a set of section polylines")  # -> flatten(Mesh); inputs Polylines: tree of Polyline, Weld: Double
# ---------- loft_mesh: C# usings ----------
using System.IO;
using System.Linq;
using System.Data;
using System.Drawing;
using System.Reflection;
using System.Windows.Forms;
using System.Xml;
using System.Xml.Linq;
using System.Runtime.InteropServices;

using Rhino.DocObjects;
using Rhino.Collections;
using GH_IO;
using GH_IO.Serialization;
# ---------- loft_mesh: C# ----------
    // create mesh
    List<int> indices = new List<int>();
    DataTree<Mesh> meshes = new DataTree<Mesh>();
    DataTree<System.Object> finalmeshes = new DataTree<System.Object>();

    // first two vertices
    for ( int k = 0; k < Polylines.BranchCount; k++ ) {
      if (Polylines.Branch(k).Count == 0){
        meshes.Add(new Mesh(), new GH_Path(Polylines.Path(k)));
      }
      else{
        for ( int j = 1; j < Polylines.Branch(k).Count; j++ ) {
          Polyline p = Polylines.Branch(k)[j - 1];
          Polyline q = Polylines.Branch(k)[j];

          Mesh m = new Mesh();

          indices.Add(m.Vertices.Add(p[0]));
          indices.Add(m.Vertices.Add(q[0]));

          // remaining vertices and faces
          for ( int i=1, imax = p.Count; i < imax; i++ ) {
            indices.Add(m.Vertices.Add(p[i]));
            indices.Add(m.Vertices.Add(q[i]));
            int len = 2 + 2 * i;
            m.Faces.AddFace(len - 4, len - 3, len - 1, len - 2);
          }

          meshes.Add(m, new GH_Path(Polylines.Path(k)));
        }
      }

      //Clean Mesh
      meshes.Branch(k)[0].Append(meshes.Branch(k).GetRange(1, meshes.Branch(k).Count - 1));
      meshes.Branch(k)[0].Vertices.CombineIdentical(true, true);
      meshes.Branch(k)[0].Unweld(Weld, true);
      meshes.Branch(k)[0].RebuildNormals();

      //Add null if mesh in branch is empty
      if (meshes.Branch(k)[0].Faces.Count == 0){
        finalmeshes.Add(null, new GH_Path(Polylines.Path(k)));
      }else{
        finalmeshes.Add(meshes.Branch(k)[0], new GH_Path(Polylines.Path(k)));
      }
    }

    Mesh = finalmeshes;
# ---------- end loft_mesh ----------
mjoin = MeshJoin(Meshes=loft_mesh)
clean = CombineClean(Meshes=mjoin)

# ---- group: RH_OUT:Panels
geo = Geometry(clean)
