# Grasshopper definition Geometry3.gh (Grasshopper 1.0.7)
# plug-ins: MeshEdit Components, Kangaroo Components

pt = ConstructPoint(XCoordinate=0, YCoordinate=0, ZCoordinate=0)
number_slider = Slider(10, range=0..100)
circle = CircleCNR(Center=pt, Normal=Vector(0, 0, 1), Radius=Slider(1.15, range=0..10))
end = EndPoints(Curve=circle)  # -> Start, End
addition = Addition(A=number_slider, B="1")
multiplication = Multiplication(A=number_slider, B=2)
hframes = HorizontalFrames(Curve=circle, Count=multiplication)  # -> Frames, Parameters
panel = Panel("""False
True""")
multiplication_2 = Multiplication(A=addition, B="3")
multiplication_3 = Multiplication(A=addition, B="2")
cull = CullPattern(List=hframes.Frames, CullPattern=panel)
deplane = DeconstructPlane(Plane=cull)  # -> Origin, XAxis, YAxis, ZAxis
padjust = AdjustPlane(Plane=cull, Normal=deplane.YAxis)
plreg = PlaneRegion(Plane=pt, Bounds=padjust)
explode = Explode(Curve=plreg, Recursive=True)  # -> Segments, Vertices
item = ListItem(List=explode.Segments, Index=0, Wrap=True)
len = Length(Curve=item)
division = Division(A=len, B="2")
X = UnitX(Factor=1)
line = LineSDL(Start=end.Start, Direction=X, Length=division)

# ---- group: RH_IN:Angle
num = Number(Slider(90, range=10..90))

# ----
neg = Negative(Value=num)
rotate = Rotate(Geometry=line, Angle=degrees(neg), Plane=end.Start)  # -> Geometry, Transform
end_2 = EndPoints(Curve=rotate.Geometry)  # -> Start, End
crv_cp = CurveClosestPoint(Point=end_2.End, Curve=circle)  # -> Point, Parameter, Distance
ln = Line(StartPoint=end_2.End, EndPoint=crv_cp.Point)
Z = UnitZ(Factor=1)
extr = Extrude(Base=ln, Direction=Z)
mirror = Mirror(Geometry=rotate.Geometry, Plane=extr)  # -> Geometry, Transform
join = JoinCurves(Curves=[rotate.Geometry, mirror.Geometry], Preserve=False)
end_3 = EndPoints(Curve=join)  # -> Start, End
ln_2 = Line(StartPoint=end_3.Start, EndPoint=pt)
extr_2 = Extrude(Base=ln_2, Direction=Z)
mirror_2 = Mirror(Geometry=join, Plane=extr_2)  # -> Geometry, Transform
end_4 = EndPoints(Curve=mirror.Geometry)  # -> Start, End
end_5 = EndPoints(Curve=mirror_2.Geometry)  # -> Start, End
neg_2 = Negative(Value=".02")
ln_3 = Line(StartPoint=end_3.End, EndPoint=end_3.Start)
ln_4 = Line(StartPoint=end_5.Start, EndPoint=end_5.End)
ln_5 = Line(StartPoint=pt, EndPoint=end_4.End)
angle = Angle(VectorA=ln_3, VectorB=ln_4)  # -> Angle, Reflex
circle_2 = CircleCNR(Center=pt, Normal=Vector(0, 0, 1), Radius=ln_5)
circle_3 = CircleCNR(Center=end_4.End, Normal=Vector(0, 0, 1), Radius=".02")
ccx = CurveCurve(CurveA=circle_3, CurveB=circle_2, UseTasks=False)  # -> Points, ParamsA, ParamsB
circle_4 = CircleCNR(Center=end_3.Start, Normal=Vector(0, 0, 1), Radius=".02")
ccx_2 = CurveCurve(CurveA=circle_4, CurveB=circle, UseTasks=False)  # -> Points, ParamsA, ParamsB
item_2 = ListItem(List=ccx.Points, Index="1", Wrap=True)  # -> Item, Item1
item_3 = ListItem(List=ccx_2.Points, Index="1", Wrap=True)  # -> Item, Item1
circle_5 = CircleCNR(Center=ccx_2.Points, Normal=Vector(0, 0, 1), Radius=".02")
circle_6 = CircleCNR(Center=ccx.Points, Normal=Vector(0, 0, 1), Radius=".02")
ln_6 = Line(StartPoint=item_2.Item, EndPoint=item_3.Item1)
merge = Merge(Data1=circle_5, Data2=circle_6)  # -> flatten(Result)
ext = ExtendCurve(Curve=ln_6, Type=0, Start=neg_2, End=neg_2)
neg_3 = Negative(Value=".005")
offset = OffsetCurve(Curve=ext, Distance=neg_3, Plane=PlaneXY(0, 0, 0), Corners=1)
offset_2 = OffsetCurve(Curve=ext, Distance=".005", Plane=PlaneXY(0, 0, 0), Corners=1)
topoly = CurveToPolyline(Curve=flatten(merge), ToleranceDistance=0, ToleranceAngle=0, MinEdge=Slider(0.01, range=0..0.01))  # -> Polyline, Segments
end_6 = EndPoints(Curve=offset_2)  # -> Start, End
end_7 = EndPoints(Curve=offset)  # -> Start, End
Z_2 = UnitZ(Factor=1)
rec_3pt = Rectangle3Pt(PointA=end_6.Start, PointB=end_6.End, PointC=end_7.Start)  # -> Rectangle, Length
pl = ConstructPlane(Origin=Point(0, 0, 0), XAxis=ln_5, YAxis=Z_2)
series = Series(Start=0, Step=angle.Angle, Count=addition)
mirror_3 = Mirror(Geometry=rec_3pt.Rectangle, Plane=pl)  # -> Geometry, Transform
flip = FlipCurve(Curve=mirror_3.Geometry)  # -> Curve, Flag
merge_2 = Merge(Data1=rec_3pt.Rectangle, Data2=flip.Curve)
rotate_2 = Rotate(Geometry=graft(topoly.Polyline), Angle=series, Plane=pt)  # -> Geometry, Transform
rotate_3 = Rotate(Geometry=graft(merge_2), Angle=series, Plane=pt)  # -> Geometry, Transform
lng = ListLength(List=flatten(rotate_3.Geometry))
Z_3 = UnitZ(Factor=Slider(3, range=0..10))
subtraction = Subtraction(A=lng, B="1")
cull_i = CullIndex(List=flatten(rotate_2.Geometry), Indices=[addition, multiplication_2, multiplication_3, number_slider], Wrap=True)
cull_i_2 = CullIndex(List=flatten(rotate_3.Geometry), Indices=[subtraction, "0"], Wrap=True)
move = Move(Geometry=flatten(cull_i), Motion=Z_3)  # -> Geometry, Transform
move_2 = Move(Geometry=flatten(cull_i_2), Motion=Z_3)  # -> Geometry, Transform
weld = Slider(0, range=0..1)
weld_2 = Slider(1, range=0..1)
weave = Weave(Pattern=[0, 1], Stream0=graft(cull_i), Stream1=graft(move.Geometry), NullGaps=False)
weave_2 = Weave(Pattern=[0, 1], Stream0=graft(cull_i_2), Stream1=graft(move_2.Geometry), NullGaps=False)
loft_mesh = CSharpScript(Polylines=weave, Weld=weld_2, TooltipTextOverride="Create a lofted mesh through a set of section polylines")  # -> flatten(Mesh); inputs Polylines: tree of Polyline, Weld: Double
# ---------- loft_mesh: C# usings ----------
using System.IO;
using System.Linq;
using System.Data;
using System.Drawing;
using System.Reflection;
using System.Windows.Forms;
using System.Xml;
using System.Xml.Linq;
using System.Runtime.InteropServices;

using Rhino.DocObjects;
using Rhino.Collections;
using GH_IO;
using GH_IO.Serialization;
# ---------- loft_mesh: C# ----------
    // create mesh
    List<int> indices = new List<int>();
    DataTree<Mesh> meshes = new DataTree<Mesh>();
    DataTree<System.Object> finalmeshes = new DataTree<System.Object>();

    // first two vertices
    for ( int k = 0; k < Polylines.BranchCount; k++ ) {
      if (Polylines.Branch(k).Count == 0){
        meshes.Add(new Mesh(), new GH_Path(Polylines.Path(k)));
      }
      else{
        for ( int j = 1; j < Polylines.Branch(k).Count; j++ ) {
          Polyline p = Polylines.Branch(k)[j - 1];
          Polyline q = Polylines.Branch(k)[j];

          Mesh m = new Mesh();

          indices.Add(m.Vertices.Add(p[0]));
          indices.Add(m.Vertices.Add(q[0]));

          // remaining vertices and faces
          for ( int i=1, imax = p.Count; i < imax; i++ ) {
            indices.Add(m.Vertices.Add(p[i]));
            indices.Add(m.Vertices.Add(q[i]));
            int len = 2 + 2 * i;
            m.Faces.AddFace(len - 4, len - 3, len - 1, len - 2);
          }

          meshes.Add(m, new GH_Path(Polylines.Path(k)));
        }
      }

      //Clean Mesh
      meshes.Branch(k)[0].Append(meshes.Branch(k).GetRange(1, meshes.Branch(k).Count - 1));
      meshes.Branch(k)[0].Vertices.CombineIdentical(true, true);
      meshes.Branch(k)[0].Unweld(Weld, true);
      meshes.Branch(k)[0].RebuildNormals();

      //Add null if mesh in branch is empty
      if (meshes.Branch(k)[0].Faces.Count == 0){
        finalmeshes.Add(null, new GH_Path(Polylines.Path(k)));
      }else{
        finalmeshes.Add(meshes.Branch(k)[0], new GH_Path(Polylines.Path(k)));
      }
    }

    Mesh = finalmeshes;
# ---------- end loft_mesh ----------
loft_mesh_2 = CSharpScript(Polylines=weave_2, Weld=weld, TooltipTextOverride="Create a lofted mesh through a set of section polylines")  # -> flatten(Mesh); inputs Polylines: tree of Polyline, Weld: Double; same code as loft_mesh
mjoin = MeshJoin(Meshes=loft_mesh)
mjoin_2 = MeshJoin(Meshes=loft_mesh_2)
flip_2 = MeshFlip(Mesh=mjoin)
flip_3 = MeshFlip(Mesh=mjoin_2)
clean = CombineClean(Meshes=flip_3)

# ---- group: RH_OUT:Cylinder
geo = Geometry(flip_2)

# ---- group: RH_OUT:Panels
geo_2 = Geometry(clean)
